# Grasshopper definition Muq_trad.ghx (Grasshopper 1.0.8)
# Copyright: 2024
# plug-ins: Bifocals

# https://khafaji.ir
# https://github.com/malikhafaji/Muqarnas
number_slider = Slider(0, range=0..100)
pt = ConstructPoint(XCoordinate=number_slider, YCoordinate=number_slider, ZCoordinate=0)
# Optional: Select Cluster
number_slider_2 = Slider(1, range=0..10)
# Draw plan divided
# by clusters
# All clusters
sliced_ngon = SlicedNgon(P=pt, raduis=Slider(125.93, range=0..1000), S=Slider(8, range=0..30))
item = ListItem(List=flatten(sliced_ngon), Index=number_slider_2, Wrap=True)
disc = Discontinuity(Curve=item, Level=1)  # -> Points, Parameters
curve_preview = CustomCurvePreview(Curve=item, Linetype="Continuous", Colour=RGB(255, 255, 255))
item_2 = ListItem(List=disc.Points, Index=0, Wrap=True)  # -> Item, Item1, Item2
ln = Line(StartPoint=item_2.Item, EndPoint=item_2.Item1)
len = Length(Curve=ln)

# ----
# Cluster line points
number_slider_3 = Slider(0.655, range=0..1)
# Cluster radius line
number_slider_4 = Slider(0.163, range=0..1)
pt_on_ln = Merge(Data1=number_slider_3, Data2=Slider(0.468, range=0..1), Data3=Slider(0.295, range=0..1), Data4=number_slider_4)
eval = EvaluateCurve(Curve=reparameterize(flatten(ln)), Parameter=graft(pt_on_ln))  # -> Point, Tangent, Angle
group = Group(Objects=eval.Point)

# ----
# Segment line
ln_2 = Line(StartPoint=item_2.Item2, EndPoint=item_2.Item1)

# ----
# Local Cplane
align = AlignPlane(Plane=item_2.Item, Direction=ln_2)  # -> Plane, Angle
Y = UnitY(Factor=1)
deplane = DeconstructPlane(Plane=align.Plane)  # -> Origin, XAxis, YAxis, ZAxis
angle = Angle(VectorA=Y, VectorB=deplane.YAxis, Plane=deplane.Origin)  # -> Angle, Reflex

# ----
# Set 2
md_slider = MDSlider(
    SliderMode=0,
    slider_value=Point(0.1035118103, 0.3363780975, 0.5),
    x_domain=Domain(0, 1),
    y_domain=Domain(0, 1),
    z_domain=Domain(0, 1))
md_slider_2 = MDSlider(
    SliderMode=0,
    slider_value=Point(0.06336784363, 0.3765201569, 0.5),
    x_domain=Domain(0, 1),
    y_domain=Domain(0, 1),
    z_domain=Domain(0, 1))
md_slider_3 = MDSlider(
    SliderMode=0,
    slider_value=Point(0, 0.3907680511, 0.5),
    x_domain=Domain(0, 1),
    y_domain=Domain(0, 1),
    z_domain=Domain(0, 1))
multiplication = Multiplication(A=[md_slider_3, md_slider_2, md_slider], B=len)
vrot = Rotate(Vector=multiplication, Axis=Vector(0, 0, 1), Angle=angle.Angle)
move = Move(Geometry=item_2.Item, Motion=vrot)  # -> Geometry, Transform

# ----
# Set 3
md_slider_4 = MDSlider(
    SliderMode=0,
    slider_value=Point(0.1667079926, 0.5041980743, 0.5),
    x_domain=Domain(0, 1),
    y_domain=Domain(0, 1),
    z_domain=Domain(0, 1))
md_slider_5 = MDSlider(
    SliderMode=0,
    slider_value=Point(0, 0.4915676117, 0.5),
    x_domain=Domain(0, 1),
    y_domain=Domain(0, 1),
    z_domain=Domain(0, 1))
multiplication_2 = Multiplication(A=[md_slider_4, md_slider_5], B=len)
vrot_2 = Rotate(Vector=multiplication_2, Axis=Vector(0, 0, 1), Angle=angle.Angle)
move_2 = Move(Geometry=item_2.Item, Motion=vrot_2)  # -> Geometry, Transform

# ----
# Set 1
md_slider_6 = MDSlider(
    SliderMode=0,
    slider_value=Point(0, 0.2039928436, 0.5),
    x_domain=Domain(0, 1),
    y_domain=Domain(0, 1),
    z_domain=Domain(0, 1))
multiplication_3 = Multiplication(A=md_slider_6, B=len)
vrot_3 = Rotate(Vector=multiplication_3, Axis=Vector(0, 0, 1), Angle=angle.Angle)
move_3 = Move(Geometry=item_2.Item, Motion=vrot_3)  # -> Geometry, Transform

# ----
# Set 4
md_slider_7 = MDSlider(
    SliderMode=0,
    slider_value=Point(0.1270923615, 0.8981723785, 0.5),
    x_domain=Domain(0, 1),
    y_domain=Domain(0, 1),
    z_domain=Domain(0, 1))
multiplication_4 = Multiplication(A=md_slider_7, B=len)
vrot_4 = Rotate(Vector=multiplication_4, Axis=Vector(0, 0, 1), Angle=angle.Angle)
move_4 = Move(Geometry=item_2.Item, Motion=vrot_4)  # -> Geometry, Transform

# ----
# Guide plan
crv = Curve([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])
curve_preview_2 = CustomCurvePreview(Curve=crv, Linetype="Continuous", Colour=RGB(115, 115, 115))

# ----
# Sample cluster
geo = Geometry(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)

height = Slider(30, range=0..100)

# ----
# Cluster line points
pshift = ShiftPaths(Data=eval.Point, Offset=-1)
points = PointList(Points=pshift, Size=3.5)

dots = DotDisplay(Point=pshift, Colour=RGB(255, 255, 255), Size=0.5)
group_2 = Group(Objects=move_3.Geometry)
group_3 = Group(Objects=move.Geometry)
group_4 = Group(Objects=move_2.Geometry)
group_5 = Group(Objects=move_4.Geometry)
entwine = Entwine(Branch00=group_5, Branch01=group_4, Branch02=group_3, Branch03=group_2, Branch04=item_2.Item, FlattenInputs=True)

# ----
# Cluster inside points
ungroup = Ungroup(Group=entwine)
pshift_2 = ShiftPaths(Data=ungroup, Offset=-2)
points_2 = PointList(Points=pshift_2, Size=3.5)

tstat = TreeStatistics(Tree=entwine)  # -> Paths, Length, Count
dots_2 = DotDisplay(Point=pshift_2, Colour=RGB(255, 0, 0), Size=0.5)
series = Series(Start=height, Step=height, Count=tstat.Count)  # -> graft(Series)
Z = UnitZ(Factor=series)
move_5 = Move(Geometry=entwine, Motion=graft(Z))  # -> Geometry, Transform
move_6 = Move(Geometry=group, Motion=Z)  # -> Geometry, Transform
bang = ExplodeTree(Data=move_5.Geometry)  # -> _00000, _00010, _00020, _00030, _00040
item_3 = ListItem(List=flatten(move_6.Geometry), Index=0, Wrap=True)  # -> Item, Item1, Item2, Item3
ungroup_2 = Ungroup(Group=item_3.Item)  # -> graft(Objects)
ungroup_3 = Ungroup(Group=item_3.Item1)  # -> graft(Objects)
ungroup_4 = Ungroup(Group=item_3.Item2)  # -> graft(Objects)
ungroup_5 = Ungroup(Group=item_3.Item3)  # -> graft(Objects)
ungroup_6 = Ungroup(Group=bang._00000)
ungroup_7 = Ungroup(Group=bang._00010)
ungroup_8 = Ungroup(Group=bang._00020)
ungroup_9 = Ungroup(Group=bang._00030)
ungroup_10 = Ungroup(Group=bang._00040)
eval_2 = EvaluateCurve(Curve=reparameterize(ln_2), Parameter=0.5)  # -> Point, Tangent, Angle
Z_2 = UnitZ(Factor=height)
item_4 = ListItem(List=ungroup_8, Index=0, Wrap=True)  # -> Item, Item1, Item2
item_5 = ListItem(List=ungroup_7, Index=0, Wrap=True)  # -> Item, Item1
move_7 = Move(Geometry=eval_2.Point, Motion=Z_2)  # -> Geometry, Transform

pt_2 = Point(ungroup_2)
pt_3 = Point(ungroup_3)
pt_4 = Point(ungroup_4)
pt_5 = Point(ungroup_5)

pt_6 = Point(ungroup_6)
pt_7 = Point(ungroup_9)
pt_8 = Point(item_4.Item)
pt_9 = Point(item_4.Item1)
pt_10 = Point(item_5.Item)
pt_11 = Point(item_5.Item1)
pt_12 = Point(ungroup_10)
pt_13 = Point(item_4.Item2)

# ----
# Draw stars
number_slider_5 = Slider(20.41, range=0..100)
star_maker = StarMaker(G=pt_2, dir=ln, radius=Slider(15.41, range=0..100), relay=Slider(3, range=0..10), B=Slider(0.2995, range=0..10))  # -> pl, pt_4
star_maker_2 = StarMaker(G=pt_11, dir=deplane.YAxis, radius=number_slider_5, relay=Slider(7, range=0..10), B=Slider(0.7995, range=0..10))  # -> pl, pt_4

# ----
# Mirror plane
line = LineSDL(Start=deplane.Origin, Direction=deplane.YAxis, Length=1)
Z_3 = UnitZ(Factor=1)
extr = Extrude(Base=line, Direction=Z_3)
evalsrf = EvaluateSurface(Surface=reparameterize(extr), Point=Point(0.5, 0.5, 0))  # -> Point, Normal, UDirection, VDirection, Frame

split_points = SplitPoints(C=star_maker.pl)  # -> outer, inner
item_6 = ListItem(List=split_points.outer, Index=0, Wrap=True)  # -> Item, Item1, Item2
item_7 = ListItem(List=split_points.inner, Index=0, Wrap=True)  # -> Item, Item1, Item2
Z_4 = UnitZ(Factor=Slider(6.753, range=0..10))
move_8 = Move(Geometry=pt_5, Motion=Z_4)  # -> graft(Geometry), Transform
lng = ListLength(List=star_maker_2.pt_4)  # -> expr("x/2", Length)
subset = SubList(List=reverse(star_maker_2.pt_4), Domain=lng, Wrap=True)  # -> List, Index
subset_2 = SubList(List=reverse(star_maker_2.pt_4), Domain="2", Wrap=True)  # -> List, Index
cull_i = CullIndex(List=subset.List, Indices=[0, 1], Wrap=True)

weave = Weave(Pattern=[0, 1, 2], Stream0=pt_8, Stream1=pt_9, Stream2=pt_13, NullGaps=False)
weave_2 = Weave(
    Pattern=[0, 1, 2, 3, 4],
    Stream0=item_6.Item,
    Stream1=item_6.Item2,
    Stream2=item_7.Item,
    Stream3=pt_6,
    Stream4=move_7.Geometry,
    NullGaps=False)
weave_3 = Weave(Pattern=[0, 1, 2], Stream0=pt_10, Stream1=subset_2.List, Stream2=pt_3, NullGaps=False)
weave_4 = Weave(Pattern=[0, 1, 2], Stream0=pt_10, Stream1=pt_3, Stream2=cull_i, NullGaps=False)
weave_5 = Weave(Pattern=[0, 1, 2, 3], Stream0=item_6.Item, Stream1=pt_6, Stream2=item_7.Item1, Stream3=move_7.Geometry, NullGaps=False)
weave_6 = Weave(Pattern=[0, 1, 2, 3], Stream0=pt_8, Stream1=pt_9, Stream2=pt_13, Stream3=pt_4, NullGaps=False)

# ----
# Sort points
fline = FitLine(Points=weave)
flip = FlipCurve(Curve=fline, Guide=ln_2)  # -> Curve, Flag
fline_2 = FitLine(Points=weave_6)
flip_2 = FlipCurve(Curve=fline_2, Guide=ln_2)  # -> Curve, Flag
fline_3 = FitLine(Points=weave_3)
flip_3 = FlipCurve(Curve=fline_3, Guide=ln)  # -> Curve, Flag
fline_4 = FitLine(Points=weave_2)
flip_4 = FlipCurve(Curve=fline_4, Guide=ln)  # -> Curve, Flag
fline_5 = FitLine(Points=weave_5)
flip_5 = FlipCurve(Curve=fline_5, Guide=ln)  # -> Curve, Flag
fline_6 = FitLine(Points=weave_4)
flip_6 = FlipCurve(Curve=fline_6, Guide=ln)  # -> Curve, Flag
alongcrv = SortAlongCurve(Points=weave, Curve=flip.Curve)  # -> reverse(Points), Indices
alongcrv_2 = SortAlongCurve(Points=weave_6, Curve=flip_2.Curve)  # -> reverse(Points), Indices
alongcrv_3 = SortAlongCurve(Points=weave_3, Curve=flip_3.Curve)  # -> reverse(Points), Indices
alongcrv_4 = SortAlongCurve(Points=weave_4, Curve=flip_6.Curve)  # -> Points, Indices
alongcrv_5 = SortAlongCurve(Points=weave_2, Curve=flip_4.Curve)  # -> Points, Indices
alongcrv_6 = SortAlongCurve(Points=weave_5, Curve=flip_5.Curve)  # -> Points, Indices

# ----
# Match patterns
panel = Panel("""1
1
5
1""")
panel_2 = Panel("""3
1
1
1
2""")
panel_3 = Panel("""1
1
1
1
3
1
3
1""")
panel_4 = Panel("""5
1
3
1
2""")
stack = StackData(Data=alongcrv_2.Points, Stack=panel)
stack_2 = StackData(Data=alongcrv_3.Points, Stack=panel_2)
stack_3 = StackData(Data=alongcrv_4.Points, Stack=panel_3)
stack_4 = StackData(Data=alongcrv_5.Points, Stack=panel_4)

# ----
# Adjust last level
number_slider_6 = Slider(9, range=0..100)
Z_5 = UnitZ(Factor=number_slider_6)  # -> expr("-x", UnitVector)
move_9 = Move(Geometry=pt_12, Motion=Z_5)  # -> Geometry, Transform
weave_7 = Weave(Pattern=[0, 1], Stream0=move_8.Geometry, Stream1=pt_7, NullGaps=False)
long = LongestList(ListA=move_9.Geometry, ListB=weave_7, PaddingMode=2)  # -> ListA, ListB
ln_3 = Line(StartPoint=long.ListA, EndPoint=long.ListB)
divide = DivideCurve(Curve=ln_3, Count=2, Kinks=False)  # -> Points, Tangents, Parameters
item_8 = ListItem(List=divide.Points, Index=0, Wrap=True)  # -> Item, Item1, Item2
Z_6 = UnitZ(Factor=Slider(3.643, range=0..10))
move_10 = Move(Geometry=item_8.Item1, Motion=Z_6)  # -> Geometry, Transform
arc = Arc3Pt(PointA=item_8.Item, PointB=move_10.Geometry, PointC=item_8.Item2)  # -> Arc, Plane, Radius
pshift_3 = ShiftPaths(Data=arc.Arc, Offset=-1)
item_9 = ListItem(List=pshift_3, Index=0, Wrap=True)  # -> Item, Item1
rulesrf = RuledSurface(CurveA=item_9.Item, CurveB=item_9.Item1)

number_slider_7 = Slider(24, range=0..100)
long_2 = LongestList(ListA=alongcrv.Points, ListB=pt_7, PaddingMode=2)  # -> ListA, ListB

# ----
# Draw arc
persian_arc = PersianArc(A=alongcrv.Points, B=long_2.ListB, curvature=number_slider_7)
persian_arc_2 = PersianArc(A=pt_4, B=move_8.Geometry, curvature=number_slider_7)
persian_arc_3 = PersianArc(A=stack_2, B=stack, curvature=number_slider_7)
persian_arc_4 = PersianArc(A=stack_4, B=stack_3, curvature=number_slider_7)
persian_arc_5 = PersianArc(A=item_2.Item1, B=alongcrv_6.Points, curvature=number_slider_7)

pshift_4 = ShiftPaths(Data=persian_arc, Offset=-1)
pshift_5 = ShiftPaths(Data=persian_arc_5, Offset=-1)
pshift_6 = ShiftPaths(Data=persian_arc_3, Offset=-1)
pshift_7 = ShiftPaths(Data=persian_arc_4, Offset=-1)
weave_8 = Weave(Pattern=[0, 1], Stream0=persian_arc_2, Stream1=pshift_4, NullGaps=False)

# ----
# Make
# surface
surface = Surface(D=weave_8)
surface_2 = Surface(D=pshift_6)
surface_3 = Surface(D=pshift_7)
surface_4 = Surface(D=pshift_5)
srf = Surface(star_maker_2.pl)
srf_2 = Surface(star_maker.pl)

group_6 = Group(Objects=flatten([rulesrf, surface, surface_2, surface_3, surface_4]))
mirror = Mirror(Geometry=group_6, Plane=evalsrf.Frame)  # -> Geometry, Transform
ungroup_11 = Ungroup(Group=[mirror.Geometry, group_6, srf, srf_2])  # -> flatten(Objects)
join = BrepJoin(Breps=ungroup_11)  # -> Breps, Closed
preview = CustomPreview(Geometry=join.Breps, Material=ColourSwatch(SwatchColor=RGBA(79, 255, 211, 116)))

# ==== cluster SlicedNgon: Draws a sliced ngon
S = ClusterInput()
raduis = ClusterInput()
P = ClusterInput()
polygon = Polygon(Plane=P, Radius=raduis, Segments=S, FilletRadius=0)  # -> Polygon, Length
rotate = Rotate(Geometry=polygon.Polygon, Angle=degrees(22.5), Plane=P)  # -> Geometry, Transform
divide = DivideCurve(Curve=rotate.Geometry, Count=1, Kinks=True)  # -> Points, Tangents, Parameters
stack = StackData(Data=divide.Points, Stack=2)
shift = ShiftList(List=stack, Shift=1, Wrap=True)
partition = PartitionList(List=shift, Size=2)
weave = Weave(Pattern=[0, 1], Stream0=P, Stream1=partition, NullGaps=False)
pline = PolyLine(Vertices=weave, Closed=True)
pl = ClusterOutput(pline)

# ==== cluster StarMaker: Draws a star
G = ClusterInput()
dir = ClusterInput()
radius = ClusterInput()
pt = Point(G)
amp = Amplitude(Vector=dir, Amplitude=radius)
vdis = VectorDisplay(Anchor=pt, Vector=amp)
relay = ClusterInput()
B = ClusterInput()
move = Move(Geometry=graft(G), Motion=amp)  # -> Geometry, Transform
align = AlignPlane(Plane=move.Geometry, Direction=expr("-x", amp))  # -> Plane, Angle
pi = Pi(Factor=2)
division = Division(A=pi, B=relay)
series = Series(Start=0, Step=expr("-x", division), Count=relay)
series_2 = Series(Start=0, Step=expr("-x/2", division), Count=expr("x*2", relay))
multiplication = Multiplication(A=radius, B=B)
pt_2 = PointCylindrical(BasePlane=align.Plane, Angle=series_2, Radius=multiplication, Elevation=0)
pt_3 = PointCylindrical(BasePlane=align.Plane, Angle=series, Radius=radius, Elevation=0)
cull = CullPattern(List=pt_2, CullPattern=[False, True])
shift = ShiftList(List=pt_3, Shift=1, Wrap=True)
weave = Weave(Pattern=[0, 1], Stream0=cull, Stream1=shift, NullGaps=False)
pline = PolyLine(Vertices=weave, Closed=True)
pt_4 = ClusterOutput(weave)
pl = ClusterOutput(pline)

# ==== cluster Surface
D = ClusterInput()
stack = StackData(Data=D, Stack=2)
shift = ShiftList(List=stack, Shift=1, Wrap=True)  # -> reverse(List)
cull_i = CullIndex(List=shift, Indices=[0, 1], Wrap=True)  # -> reverse(List)
cull = CullPattern(List=cull_i, CullPattern=invert([True, False]))
cull_2 = CullPattern(List=cull_i, CullPattern=[True, False])
rulesrf = RuledSurface(CurveA=cull, CurveB=cull_2)
S = ClusterOutput(rulesrf)

# ==== cluster SplitPoints: Split 2d star curves discontinuity points to inner and outer point lists.
C = ClusterInput()
disc = Discontinuity(Curve=C, Level=1)  # -> Points, Parameters
avr = Average(Input=disc.Points)
dist = Distance(PointA=disc.Points, PointB=avr)
bnd = Bounds(Numbers=dist)
dedomain = DeconstructDomain(Domain=bnd)  # -> Start, End
similar = Similarity(FirstNumber=dist, SecondNumber=dedomain.End, Threshold=0.1)  # -> Similarity, AbsoluteDifference
cull = CullPattern(List=disc.Points, CullPattern=invert(similar.Similarity))
cull_2 = CullPattern(List=disc.Points, CullPattern=similar.Similarity)
outer = ClusterOutput(cull_2)  # Returns outer edge points
inner = ClusterOutput(cull)  # Returns inner edge points

# ==== cluster PersianArc: Draws Persian arc between 2 points
B = ClusterInput()
A = ClusterInput()
curvature = ClusterInput()
long = LongestList(ListA=A, ListB=B, PaddingMode=2)  # -> ListA, ListB
Z = UnitZ(Factor=curvature)
move = Move(Geometry=long.ListA, Motion=Z)  # -> Geometry, Transform
weave = Weave(Pattern=[0, 1, 2], Stream0=graft(long.ListA), Stream1=graft(move.Geometry), Stream2=graft(long.ListB), NullGaps=False)
nurbs = NurbsCurve(Vertices=weave, Degree=2, Periodic=False)  # -> Curve, Length, Domain
curve = ClusterOutput(nurbs.Curve)
